# Grasshopper definition 1.1 Extract and relocate beams.gh (Grasshopper 1.0.7)
# plug-ins: Speckle 2

# ----
# Import incoming elements (latest commit)
panel = Panel("https://speckle.xyz/streams/c4c6aed0b8/branches/main")
receive = Receive(
    Stream=panel,
    AutoReceive=True,
    CurrentComponentState="up_to_date",
    ExpandOutput=True,
    LastInfoMessage="Artur Tomczak @ 2022-05-12T16:51:34.090Z: Sent 737 objects from Revit2022. (id:c2057b14aa)",
    ReceiveOnOpen=False,
    ReceivedCommitId="c2057b14aa",
    StreamWrapper="https://speckle.xyz/streams/c4c6aed0b8/branches/main",
    selectedKitName="Objects")  # -> Info, Areas, CableTrays, Ceilings, Conduits, CurtainSystems, Doors, DuctSystems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

eso = ExpandSpeckleObject(SpeckleObject=flatten(receive.StructuralFraming), selectedKitName="Objects")  # -> BaseLine, Category, DisplayMesh, DisplayValue, ElementId, Family, Level, Parameters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
mesh = Mesh(eso.DisplayMesh)
line = Line(eso.BaseLine)
expand_speckle_object = ExpandSpeckleObject(SpeckleObject=eso.Parameters, selectedKitName="Objects")  # -> _0a80a6d495714df6967703211e72047a, _12ddbfbc91be4e738f2d5a1a443fdb1e, _743151a73a0340509ff33f0512be0e93, _74b1142d1fae4be5B45f43329c8998c4, _8e657701Bfb64af68cdd7f290a73b563, A2093d5631794eb1A15a8174dd85c598, ALL_MODEL_INSTANCE_COMMENTS, ALL_MODEL_TYPE_COMMENTS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

# ----
# Take only non-empty element's names
line_2 = Line(line)
text = Text(eso.Type)
list_length = ListLength(List=line_2)
equality = Equality(FirstNumber=list_length, SecondNumber="0")  # -> Equality, Inequality
dispatch = Dispatch(List=text, DispatchPattern=equality.Inequality)  # -> ListA, ListB
text_2 = Text(flatten(dispatch.ListA))

mesh_2 = Mesh(flatten(mesh))

# ----
# Orient to XY
line_3 = Line(flatten(line))

end_points = EndPoints(Curve=line_3)  # -> Start, End

pl = PlaneNormal(Origin=end_points.Start, ZAxis=line_3)
orient = Orient(Geometry=mesh_2, Source=pl, Target=PlaneXY(0, 0, 0))  # -> Geometry, Transform
rotate = Rotate(Geometry=orient.Geometry, Angle=1.570796327, Plane=PlaneXY(0, 0, 0))  # -> Geometry, Transform
geo = Geometry(rotate.Geometry)

orient_2 = Orient(Geometry=line_3, Source=pl, Target=PlaneXY(0, 0, 0))  # -> Geometry, Transform

# ----
# Measure geometrical section height
mesh_3 = Mesh(flatten(geo))
deconstruct_mesh = DeconstructMesh(Mesh=mesh_3)  # -> Vertices, Faces, Colours, Normals
deconstruct = Deconstruct(Point=deconstruct_mesh.Vertices)  # -> XComponent, YComponent, ZComponent
sort_list = SortList(Keys=deconstruct.YComponent)  # -> Keys, ValuesValuesA
sort_list_2 = SortList(Keys=deconstruct.XComponent)  # -> Keys, ValuesA
list_item = ListItem(List=sort_list.Keys, Index="-1", Wrap=True)
list_item_2 = ListItem(List=sort_list.Keys, Index="0", Wrap=True)
list_item_3 = ListItem(List=sort_list_2.Keys, Index="-1", Wrap=True)
list_item_4 = ListItem(List=sort_list_2.Keys, Index="0", Wrap=True)
subtraction = Subtraction(A=list_item, B=list_item_2)
subtraction_2 = Subtraction(A=list_item_3, B=list_item_4)
maximum = Maximum(A=subtraction_2, B=subtraction)
round = Round(Number=maximum)  # -> Nearest, Floor, Ceiling
number = Number(flatten(round.Nearest))

# ----
# Sort by length
line_4 = Line(orient_2.Geometry)
height = Number(flatten(number))
text_3 = Text(flatten(text_2))
mesh_4 = Mesh(geo)
len = Length(Curve=line_4)
sort = SortList(Keys=len, ValuesA=height)  # -> Keys, ValuesA
sort_2 = SortList(Keys=len, ValuesA=text_3)  # -> Keys, ValuesA
sort_3 = SortList(Keys=len, ValuesA=line_4)  # -> Keys, ValuesA
sort_4 = SortList(Keys=len, ValuesA=mesh_4)  # -> Keys, ValuesA
text_4 = Text(sort_2.ValuesA)
height_2 = Number(sort.ValuesA)
mesh_5 = Mesh(sort_4.ValuesA)
line_5 = Line(sort_3.ValuesA)

# ----
# Color by height
sort_list_3 = SortList(Keys=height_2)  # -> Keys, ValuesA
list_item_5 = ListItem(List=sort_list_3.Keys, Index="0", Wrap=True)
list_item_6 = ListItem(List=sort_list_3.Keys, Index="-1", Wrap=True)
construct_domain = ConstructDomain(DomainStart="0", DomainEnd="255")
construct_domain_2 = ConstructDomain(DomainStart=list_item_5, DomainEnd=list_item_6)
remap_numbers = RemapNumbers(Value=height_2, Source=construct_domain_2, Target=construct_domain)  # -> Mapped, Clipped
subtraction_3 = Subtraction(A="255", B=remap_numbers.Mapped)
colour_rgb = ColourRGB(Alpha="125", Red=subtraction_3, Green=remap_numbers.Mapped, Blue=0)
rendermaterial = RenderMaterial(
    Opacity="1",
    Metalness=0,
    Roughness=1,
    Diffuse=colour_rgb,
    SelectedConstructorName="Objects.Other.RenderMaterial.ctor(System.Double,System.Double,System.Double,System.Nullable`1[System.Drawing.Color],System.Nullable`1[System.Drawing.Color])",
    SelectedTypeName="Objects.Other.RenderMaterial",
    UseSchemaTag=False,
    UserSetSchemaTag=False,
    seed="751f623aa418e7b99513")

# ----
# Distribute by length
mesh_6 = Mesh(mesh_5)
height_3 = Number(height_2)
line_6 = Line(line_5)
spacing_in_mm = Panel("250")
addition = Addition(A=height_3, B=spacing_in_mm)

ghpython_script = GhPythonScript(x=addition)  # -> out, a; inputs x: list
# ---------- ghpython_script: Python ----------
__author__ = "arturbt"
__version__ = "2022.05.12"

import rhinoscriptsyntax as rs

a=[x[0]]

for i in range(1, len(x)):
    a.append(a[-1] + x[i])
# ---------- end ghpython_script ----------

X = UnitX(Factor=ghpython_script.a)
move = Move(Geometry=line_6, Motion=X)  # -> Geometry, Transform
move_2 = Move(Geometry=mesh_6, Motion=X)  # -> Geometry, Transform
line_7 = Line(move.Geometry)
mesh_7 = Mesh(move_2.Geometry)

# ----
# Create Speckle objects
line_8 = Line(line_7)
text_5 = Text(text_4)
height_4 = Number(height_2)
mesh_8 = Mesh(mesh_7)
to_speckle = ToSpeckle(Data=mesh_8, selectedKitName="Objects")
extend_speckle_object = ExtendSpeckleObject(
    SpeckleObject=to_speckle,
    RenderMaterial=rendermaterial,
    LocationLine=line_8,
    TypeName=text_5,
    Height=height_4,
    selectedKitName="Objects")

# ----
# Refresh the Material Bank
panel_2 = Panel("https://speckle.xyz/streams/c4c6aed0b8/branches/preprocessed")
synchronous_sender = SynchronousSender(
    Data=extend_speckle_object,
    Stream=panel_2,
    KitName="Objects",
    OutputWrappers="https://speckle.xyz\tc4c6aed0b8\tf1696e067b",
    UseDefaultCache=True)
