# Grasshopper definition 2.1 Read and map elements from MB.gh (Grasshopper 1.0.7)
# plug-ins: Speckle 2

# ----
# Import current Material Bank elements (latest commit)
panel = Panel("https://speckle.xyz/streams/6208e0daa1/commits/c4540bdd0a?c=%5B-19.7162,-11.84107,23.42971,4.33686,2.81836,7.49205,0,1%5D")
receive = Receive(
    Stream=panel,
    AutoReceive=False,
    CurrentComponentState="expired",
    ExpandOutput=True,
    LastInfoMessage="Artur Tomczak @ 2022-05-13T15:33:08.735Z: Pushed 173 elements from Grasshopper. (id:c4540bdd0a)",
    ReceiveOnOpen=False,
    ReceivedCommitId="c4540bdd0a",
    StreamWrapper="https://speckle.xyz/streams/6208e0daa1/commits/c4540bdd0a",
    selectedKitName="None")  # -> Info, Data
eso = ExpandSpeckleObject(SpeckleObject=receive.Data, selectedKitName="Objects")  # -> Area, Bbox, Colors, Faces, LocationLine, RenderMaterial, TextureCoordinates, TextureCoordinatesCount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
to_native = ToNative(Base=receive.Data, selectedKitName="Objects")
line = Line(flatten(eso.LocationLine))
mesh = Mesh(to_native)

panel_2 = Panel(eso.TypeName)

# ----
# Temp cast to Y=0
line_2 = Line(flatten([Line((1613, 5469, 0), (1613, 5469, 4242.640687)), Line((882, 1789, 0), (882, 1789, 3000)), Line((882, 1789, 0), (882, 1789, 3000)), Line((882, 1789, 0), (882, 1789, 3000)), Line((882, 1789, 0), (882, 1789, 3000)), Line((882, 1789, 0), (882, 1789, 3000))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]))
end = EndPoints(Curve=line_2)  # -> Start, End
pdecon = Deconstruct(Point=end.End)  # -> XComponent, YComponent, ZComponent
pdecon_2 = Deconstruct(Point=end.Start)  # -> XComponent, YComponent, ZComponent
pt = ConstructPoint(XCoordinate=pdecon.XComponent, YCoordinate="-2000", ZCoordinate=pdecon.ZComponent)
pt_2 = ConstructPoint(XCoordinate=pdecon_2.XComponent, YCoordinate="-2000", ZCoordinate=pdecon_2.ZComponent)
ln = Line(StartPoint=pt_2, EndPoint=pt)
line_3 = Line(flatten(ln))

# ----
# Distribute by area in Y direction
cutting_plane_mm = Panel("250")  # disabled
pt_3 = ConstructPoint(XCoordinate=0, YCoordinate=0, ZCoordinate=cutting_plane_mm)  # disabled
pl = PlaneNormal(Origin=pt_3, ZAxis=Vector(0, 0, 1))  # disabled
sec = MeshPlane(Plane=pl)  # disabled
boundary = BoundarySurfaces(Edges=sec)  # -> flatten(Surfaces); disabled
area = Area(Geometry=boundary)  # -> Area, Centroid; disabled
panel_3 = Panel("3000")  # disabled
panel_4 = Panel("300")  # disabled
panel_5 = Panel("5000")  # disabled
panel_6 = Panel("0")  # disabled
value = Number(area.Area)  # disabled
dom = ConstructDomain(DomainStart=panel_4, DomainEnd=panel_3)  # disabled
dom_2 = ConstructDomain(DomainStart=panel_6, DomainEnd=panel_5)  # disabled
remap = RemapNumbers(Value=value, Source=dom, Target=dom_2)  # -> Mapped, Clipped; disabled
round = Round(Number=remap.Mapped)  # -> Nearest, Floor, Ceiling; disabled

# ----
# New structure design
number_slider = Slider(8172, range=0..15000)
number_slider_2 = Slider(7434, range=0..15000)
number_slider_3 = Slider(2810, range=0..15000)
pt_4 = ConstructPoint(XCoordinate=0, YCoordinate=number_slider, ZCoordinate=0)
pt_5 = ConstructPoint(XCoordinate=number_slider_2, YCoordinate=number_slider_3, ZCoordinate=0)
pt_6 = ConstructPoint(XCoordinate=0, YCoordinate=number_slider_3, ZCoordinate=0)

pt_7 = ConstructPoint(XCoordinate=number_slider_2, YCoordinate=number_slider, ZCoordinate=0)
pt_8 = ConstructPoint(XCoordinate=number_slider_2, YCoordinate=number_slider, ZCoordinate=Slider(3690, range=0..15000))
pt_9 = ConstructPoint(XCoordinate=0, YCoordinate=number_slider, ZCoordinate=Slider(6050, range=0..15000))
pt_10 = ConstructPoint(XCoordinate=number_slider_2, YCoordinate=number_slider_3, ZCoordinate=Slider(2605, range=0..15000))
pt_11 = ConstructPoint(XCoordinate=0, YCoordinate=number_slider_3, ZCoordinate=Slider(2351, range=0..15000))
merge = Merge(Data1=pt_11, Data2=pt_10, Data3=pt_8, Data4=pt_9)
merge_2 = Merge(Data1=pt_6, Data2=pt_5, Data3=pt_7, Data4=pt_4)
shift = ShiftList(List=merge, Shift=1, Wrap=True)
ln_2 = Line(StartPoint=merge, EndPoint=shift)
ln_3 = Line(StartPoint=merge_2, EndPoint=merge)
merge_3 = Merge(Data1=ln_3, Data2=ln_2)  # -> flatten(Result)

line_4 = Line(merge_3)

# ----
# Orient to XY
line_5 = Line(flatten(line_4))
end_2 = EndPoints(Curve=line_5)  # -> Start, End
pl_2 = PlaneNormal(Origin=end_2.Start, ZAxis=line_5)
orient = Orient(Geometry=line_5, Source=pl_2, Target=PlaneXY(0, 0, 0))  # -> Geometry, Transform
line_6 = Line(flatten(orient.Geometry))
len = Length(Curve=line_6)

# ----
# Distribute by length in X direction
value_2 = Number(len)
dom_3 = ConstructDomain(DomainStart="0", DomainEnd="5000")
dom_4 = ConstructDomain(DomainStart="1500", DomainEnd="10000")
remap_2 = RemapNumbers(Value=value_2, Source=dom_4, Target=dom_3)  # -> Mapped, Clipped
round_2 = Round(Number=remap_2.Mapped)  # -> Nearest, Floor, Ceiling

X = UnitX(Factor=round_2.Nearest)
line_7 = Line(line_6)
Y = UnitY(Factor=round.Nearest)
addition = Addition(A=X, B=Y)
move = Move(Geometry=line_7, Motion=addition)  # -> Geometry, Transform
line_8 = Line(move.Geometry)

# ----
# Do the mapping
material_bank_lines = Line(line_3)
new_design_lines = Line(line_8)
genes = GenePool(Decimals=0, Maximum=171, Minimum=0, Value=[70, 76, 144, 111, 99, 55, 130, 132])
suck_it = CSharpScript(bankLines=material_bank_lines, objectLines=new_design_lines, ib=genes)  # -> wars, ranking, mappingLines, newBank, result; inputs bankLines: list of Line, objectLines: list of Line, ib: list of Int32, jo: list of Int32
# ---------- suck_it: C# usings ----------
using System.Linq;
# ---------- suck_it: C# ----------
    int n = objectLines.Count;
    List<string> info = new List<string>();
    List<double> rank = new List<double>();
    List<int> map = new List<int>();
    List<Line> lines = new List<Line>();

    for (int i = 0; i < n; i++)
    {
      Line ol = objectLines[i];
      Line bl = bankLines[ib[i]];
      map.Add(ib[i]);
      double lol = ol.Length;
      double lbl = bl.Length;

      double dif = lbl - lol;
      info.Add("dif = " + dif);
      if(dif < 0)
      {
        //to small element, we have to punish it
        rank.Add(50);
      }
      else if (dif == 0)
      {
        //perfect match
        rank.Add(0);
      }
      else if (dif < 900 && dif > 0)
      {
        //not so bad match the waste is less than 0.9m
        rank.Add(5);
      }
      else if (dif >= 900 && dif > 0)
      {
        //not so bad match the waste is more than 0.9m
        rank.Add(2);
        bankLines.Add(new Line(new Point3d(0, 0, 0), new Point3d(dif, 0, 0)));
      }

      lines.Add(new Line(ol.PointAt(0.5), bl.PointAt(0.5)));
    }


    int nm = map.Count;
    List<int> mapd = map.Distinct().ToList();
    int nmd = mapd.Count;
    info.Add("nm = " + nm);
    info.Add("nmd = " + nmd);
    //extra punishment for using the same elements from bank to object
    rank.Add(Convert.ToDouble(nm - nmd) * 100);


    foreach(var im in map)
      bankLines.RemoveAt(im);

    double res = 0;
    foreach(var r in rank)
      res = res + r;



    //output
    result = res;
    ranking = rank;
    wars = info;
    newBank = bankLines;
    mappingLines = lines;
# ---------- end suck_it ----------
galapagos = Galapagos(fitness=num, gene=genes)
num = Number(suck_it.result)
panel_7 = Panel(suck_it.wars)
panel_8 = Panel(num)
panel_9 = Panel(suck_it.ranking)

item = ListItem(List=material_bank_lines, Index=genes, Wrap=True)

# ----
# Display mapping
line_9 = Line(suck_it.mappingLines)
end_3 = EndPoints(Curve=line_9)  # -> Start, End
pdecon_3 = Deconstruct(Point=end_3.End)  # -> XComponent, YComponent, ZComponent
pdecon_4 = Deconstruct(Point=end_3.Start)  # -> XComponent, YComponent, ZComponent
pt_12 = ConstructPoint(XCoordinate=pdecon_3.XComponent, YCoordinate=pdecon_3.YComponent, ZCoordinate=0)
pt_13 = ConstructPoint(XCoordinate=pdecon_4.XComponent, YCoordinate=pdecon_4.YComponent, ZCoordinate=0)
ln_4 = Line(StartPoint=pt_13, EndPoint=pt_12)
pipe = Pipe(Curve=ln_4, Radius=Slider(46, range=0..100), Caps=0)
preview = CustomPreview(Geometry=pipe, Material=ColourSwatch(SwatchColor=RGBA(0, 255, 255, 128)))

pipe_2 = Pipe(Curve=material_bank_lines, Radius=Slider(44, range=0..100), Caps=0)
pipe_3 = Pipe(Curve=item, Radius=Slider(100, range=0..100), Caps=0)
pipe_4 = Pipe(Curve=new_design_lines, Radius=Slider(100, range=0..100), Caps=0)
preview_2 = CustomPreview(Geometry=pipe_4, Material=ColourSwatch(SwatchColor=RGB(162, 250, 0)))
preview_3 = CustomPreview(Geometry=pipe_2, Material=ColourSwatch(SwatchColor=RGBA(255, 255, 255, 126)))
preview_4 = CustomPreview(Geometry=pipe_3, Material=ColourSwatch(SwatchColor=RGB(255, 255, 255)))
