# Grasshopper definition 2.1 Read and map elements from MB_v1_Artur.gh (Grasshopper 1.0.7)
# plug-ins: Speckle 2

# ----
# Import current Material Bank elements (latest commit)
panel = Panel("https://speckle.xyz/streams/6208e0daa1/branches/3_material_bank")
receive = Receive(
    Stream=panel,
    AutoReceive=False,
    CurrentComponentState="expired",
    ExpandOutput=True,
    LastInfoMessage="Artur Tomczak @ 2022-05-13T15:33:08.735Z: Pushed 173 elements from Grasshopper. (id:c4540bdd0a)",
    ReceiveOnOpen=False,
    ReceivedCommitId="c4540bdd0a",
    StreamWrapper="https://speckle.xyz/streams/6208e0daa1/branches/3_material_bank",
    selectedKitName="None")  # -> Info, Data
expand_speckle_object = ExpandSpeckleObject(SpeckleObject=receive.Data, selectedKitName="Objects")  # -> Area, Bbox, Colors, Faces, LocationLine, RenderMaterial, TextureCoordinates, TextureCoordinatesCount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
to_native = ToNative(Base=receive.Data, selectedKitName="Objects")
line = Line(flatten(expand_speckle_object.LocationLine))
mesh = Mesh(to_native)

# ----
# Temp cast to Y=0
line_2 = Line(flatten([Line((1613, 5469, 0), (1613, 5469, 4242.640687)), Line((882, 1789, 0), (882, 1789, 3000)), Line((882, 1789, 0), (882, 1789, 3000)), Line((882, 1789, 0), (882, 1789, 3000)), Line((882, 1789, 0), (882, 1789, 3000)), Line((882, 1789, 0), (882, 1789, 3000))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]))
end = EndPoints(Curve=line_2)  # -> Start, End
pdecon = Deconstruct(Point=end.End)  # -> XComponent, YComponent, ZComponent
pdecon_2 = Deconstruct(Point=end.Start)  # -> XComponent, YComponent, ZComponent
pt = ConstructPoint(XCoordinate=pdecon.XComponent, YCoordinate="-2000", ZCoordinate=pdecon.ZComponent)
pt_2 = ConstructPoint(XCoordinate=pdecon_2.XComponent, YCoordinate="-2000", ZCoordinate=pdecon_2.ZComponent)
ln = Line(StartPoint=pt_2, EndPoint=pt)
line_3 = Line(flatten(ln))

# ----
# Distribute by area in Y direction
cutting_plane_mm = Panel("250")  # disabled
pt_3 = ConstructPoint(XCoordinate=0, YCoordinate=0, ZCoordinate=cutting_plane_mm)  # disabled
pl = PlaneNormal(Origin=pt_3, ZAxis=Vector(0, 0, 1))  # disabled
sec = MeshPlane(Plane=pl)  # disabled
boundary = BoundarySurfaces(Edges=sec)  # -> flatten(Surfaces); disabled
area = Area(Geometry=boundary)  # -> Area, Centroid; disabled
panel_2 = Panel("3000")  # disabled
panel_3 = Panel("300")  # disabled
panel_4 = Panel("5000")  # disabled
panel_5 = Panel("0")  # disabled
value = Number(area.Area)  # disabled
dom = ConstructDomain(DomainStart=panel_3, DomainEnd=panel_2)  # disabled
dom_2 = ConstructDomain(DomainStart=panel_5, DomainEnd=panel_4)  # disabled
remap = RemapNumbers(Value=value, Source=dom, Target=dom_2)  # -> Mapped, Clipped; disabled
round = Round(Number=remap.Mapped)  # -> Nearest, Floor, Ceiling; disabled

# ----
# New structure design
number_slider = Slider(8172, range=0..15000)
number_slider_2 = Slider(7434, range=0..15000)
number_slider_3 = Slider(2810, range=0..15000)
pt_4 = ConstructPoint(XCoordinate=0, YCoordinate=number_slider, ZCoordinate=0)
pt_5 = ConstructPoint(XCoordinate=number_slider_2, YCoordinate=number_slider_3, ZCoordinate=0)
pt_6 = ConstructPoint(XCoordinate=0, YCoordinate=number_slider_3, ZCoordinate=0)

pt_7 = ConstructPoint(XCoordinate=number_slider_2, YCoordinate=number_slider, ZCoordinate=0)
pt_8 = ConstructPoint(XCoordinate=number_slider_2, YCoordinate=number_slider, ZCoordinate=Slider(3690, range=0..15000))
pt_9 = ConstructPoint(XCoordinate=0, YCoordinate=number_slider, ZCoordinate=Slider(6050, range=0..15000))
pt_10 = ConstructPoint(XCoordinate=number_slider_2, YCoordinate=number_slider_3, ZCoordinate=Slider(2605, range=0..15000))
pt_11 = ConstructPoint(XCoordinate=0, YCoordinate=number_slider_3, ZCoordinate=Slider(2351, range=0..15000))
merge = Merge(Data1=pt_11, Data2=pt_10, Data3=pt_8, Data4=pt_9)
merge_2 = Merge(Data1=pt_6, Data2=pt_5, Data3=pt_7, Data4=pt_4)
shift = ShiftList(List=merge, Shift=1, Wrap=True)
ln_2 = Line(StartPoint=merge, EndPoint=shift)
ln_3 = Line(StartPoint=merge_2, EndPoint=merge)
merge_3 = Merge(Data1=ln_3, Data2=ln_2)  # -> flatten(Result)

line_4 = Line(merge_3)

# ----
# Orient to XY
line_5 = Line(flatten(line_4))
end_2 = EndPoints(Curve=line_5)  # -> Start, End
pl_2 = PlaneNormal(Origin=end_2.Start, ZAxis=line_5)
orient = Orient(Geometry=line_5, Source=pl_2, Target=PlaneXY(0, 0, 0))  # -> Geometry, Transform
line_6 = Line(flatten(orient.Geometry))
len = Length(Curve=line_6)

# ----
# Distribute by length in X direction
value_2 = Number(len)
dom_3 = ConstructDomain(DomainStart="0", DomainEnd="5000")
dom_4 = ConstructDomain(DomainStart="1500", DomainEnd="10000")
remap_2 = RemapNumbers(Value=value_2, Source=dom_4, Target=dom_3)  # -> Mapped, Clipped
round_2 = Round(Number=remap_2.Mapped)  # -> Nearest, Floor, Ceiling

X = UnitX(Factor=round_2.Nearest)
line_7 = Line(line_6)
Y = UnitY(Factor=round.Nearest)
addition = Addition(A=X, B=Y)
move = Move(Geometry=line_7, Motion=addition)  # -> Geometry, Transform
line_8 = Line(move.Geometry)

# ----
# Do the mapping
material_bank_lines = Line(line_3)
new_design_lines = Line(line_8)
len_2 = Length(Curve=material_bank_lines)
len_3 = Length(Curve=new_design_lines)
sort_list = SortList(Keys=len_3, ValuesValuesA=new_design_lines)  # -> reverse(Keys), ValuesValuesA
sort_list_2 = SortList(Keys=len_2, ValuesA=material_bank_lines)  # -> Keys, ValuesA
python = GhPythonScript(bank=sort_list_2.Keys, new=sort_list.Keys)  # -> out, map, count, bank; inputs bank: list, new: list
# ---------- python: Python ----------
__author__ = "arturbt"
__version__ = "2022.05.13"

import rhinoscriptsyntax as rs

# index of correcponding Material Bank element
map = []
updated_bank = bank[:]

for n in new:
    found=False
    count=0
    for i in range(len(bank)):
        if updated_bank[i] >= n:
            found=True
            map.append(i)
            del updated_bank[i]
            count += 1
            break
    if not found:
        map.append(-1)
# ---------- end python ----------
panel_6 = Panel(python.map)
panel_7 = Panel(python.count)
panel_8 = Panel(python.bank)
material_bank_lines_2 = Line(sort_list_2.ValuesA)
new_design_lines_2 = Line(sort_list.ValuesValuesA)
list_item = ListItem(List=material_bank_lines_2, Index=python.map, Wrap=True)
end_points = EndPoints(Curve=list_item)  # -> Start, End
end_points_2 = EndPoints(Curve=new_design_lines_2)  # -> Start, End
line_9 = Line(StartPoint=end_points.Start, EndPoint=end_points_2.Start)
