# Grasshopper definition Send_models.gh (Grasshopper 1.0.7)
# plug-ins: Speckle 2

panel = Panel("https://speckle.xyz/streams/c4c6aed0b8")
geo = Geometry([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])
geo_2 = Geometry(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)
Y = UnitY(Factor=20)
Y_2 = UnitY(Factor=10)
boundary = BoundarySurfaces(Edges=geo)
boundary_2 = BoundarySurfaces(Edges=geo_2)
extr = Extrude(Base=boundary, Direction=Y)
extr_2 = Extrude(Base=boundary_2, Direction=Y_2)
send = Send(
    Stream=panel,
    Message="Model 1, commit 1",
    Data=extr_2,
    AutoSend=False,
    BaseId="c26fb57b6de6404256cce1d5073a306c",
    CurrentComponentState="expired",
    KitName="Objects",
    OutputWrappers="https://speckle.xyz\tc4c6aed0b8\t913ba8297c",
    UseDefaultCache=True,
    selectedKitName="Objects")
send_2 = Send(
    Stream=panel,
    Message="Model 2, commit 1",
    Data=extr,
    AutoSend=False,
    BaseId="9556fb6628ddee4fe6d1b19c51fad718",
    CurrentComponentState="expired",
    KitName="Objects",
    OutputWrappers="https://speckle.xyz\tc4c6aed0b8\t0dc2503ca4",
    UseDefaultCache=True,
    selectedKitName="Objects")
