# Grasshopper definition Read_bank.gh (Grasshopper 1.0.7)
# plug-ins: Speckle 2

panel = Panel("https://speckle.xyz/streams/c9c12bb7c7/branches/main")
receive = Receive(
    Stream=panel,
    AutoReceive=False,
    CurrentComponentState="expired",
    ExpandOutput=True,
    LastInfoMessage="Artur Tomczak @ 2022-05-11T15:32:26.239Z: Updated Material Bank (id:3b5a4cc7b7)",
    ReceiveOnOpen=False,
    ReceivedCommitId="3b5a4cc7b7",
    StreamWrapper="https://speckle.xyz/streams/c9c12bb7c7/branches/main",
    selectedKitName="Objects")  # -> Info, Data
sr = SynchronousReceiver(
    Stream=panel,
    AutoReceive=False,
    KitName="Objects",
    ReceivedObjectId="6d232110cbb7b0392690ce81ecd80ae3",
    StreamWrapper="https://speckle.xyz/streams/c9c12bb7c7/branches/main",
    selectedKitName="Objects")  # -> Data, Info
panel_2 = Panel(sr.Data)
eso = ExpandSpeckleObject(SpeckleObject=sr.Data, selectedKitName="Objects")
panel_3 = Panel(receive.Data)
panel_4 = Panel(eso)
