# Grasshopper definition Relocate_elements.gh (Grasshopper 1.0.7)
# plug-ins: Speckle 2

# ----
# Import incoming elements (latest commit)
panel = Panel("https://speckle.xyz/streams/c4c6aed0b8")
receive = Receive(
    Stream=panel,
    AutoReceive=True,
    CurrentComponentState="up_to_date",
    ExpandOutput=True,
    LastInfoMessage="Artur Tomczak @ 2022-05-12T16:51:34.090Z: Sent 737 objects from Revit2022. (id:c2057b14aa)",
    ReceiveOnOpen=False,
    ReceivedCommitId="c2057b14aa",
    StreamWrapper="https://speckle.xyz/streams/c4c6aed0b8",
    selectedKitName="Objects")  # -> Info, Areas, CableTrays, Ceilings, Conduits, CurtainSystems, Doors, DuctSystems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

eso = ExpandSpeckleObject(SpeckleObject=flatten(receive.StructuralFraming), selectedKitName="Objects")  # -> BaseLine, Category, DisplayMesh, DisplayValue, ElementId, Family, Level, Parameters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
expand_speckle_object = ExpandSpeckleObject(SpeckleObject=eso.Parameters, selectedKitName="Objects")  # -> _0a80a6d495714df6967703211e72047a, _12ddbfbc91be4e738f2d5a1a443fdb1e, _743151a73a0340509ff33f0512be0e93, _74b1142d1fae4be5B45f43329c8998c4, _8e657701Bfb64af68cdd7f290a73b563, A2093d5631794eb1A15a8174dd85c598, ALL_MODEL_INSTANCE_COMMENTS, ALL_MODEL_TYPE_COMMENTS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
text = Text(eso.Type)
mesh = Mesh(eso.DisplayMesh)
line = Line(eso.BaseLine)
panel_2 = Panel(text)
eso_2 = ExpandSpeckleObject(selectedKitName="Objects")  # -> DisplayMesh, Type
panel_3 = Panel(eso_2.Type)
geo = Geometry(flatten(eso_2.DisplayMesh))
geo_2 = Geometry(flatten([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]))

# ----
# Longest edge == direction
# Perpendicular face == profile
debrep = DeconstructBrep(Brep=geo_2)  # -> simplify(Faces), simplify(Edges), Vertices
len = Length(Curve=debrep.Edges)
sort = SortList(Keys=len, ValuesA=debrep.Edges)  # -> Keys, ValuesA
item = ListItem(List=sort.ValuesA, Index=-1, Wrap=True)
normal_vector = Vector(item)
pt = ConstructPoint(XCoordinate=0.5, YCoordinate=0.5, ZCoordinate=0)
evalsrf = EvaluateSurface(Surface=debrep.Faces, Point=pt)  # -> Point, Normal, UDirection, VDirection, Frame
dprod = DotProduct(VectorA=evalsrf.Normal, VectorB=normal_vector, Unitize=False)
subtraction = Subtraction(A=dprod, B="1")
larger = LargerThan(FirstNumber=subtraction, SecondNumber="-0.0001")  # -> LargerThan, OrEqualTo
cull = CullPattern(List=debrep.Faces, CullPattern=larger.LargerThan)
profile_srf = Surface(cull)

line_2 = Line(flatten(item))

geometry = Geometry([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])
mesh_brep = MeshBrep(
    Brep=geometry,
    Settings={GridMaxCount=0, GridMinCount=16, JaggedSeams=False, MaxEdgeLength=0, MinEdgeLength=0.0001, MinTolerance=0, Refine=True, RefineAngle=0, RelativeTolerance=0.65, SimplePlanes=True, Tolerance=0})
create_schema_object = RenderMaterial(
    Opacity=1,
    Metalness=0,
    Roughness=1,
    Diffuse=[ColourSwatch(SwatchColor=RGB(235, 173, 49)), ColourSwatch(SwatchColor=RGB(52, 168, 66))],
    SelectedConstructorName="Objects.Other.RenderMaterial.ctor(System.Double,System.Double,System.Double,System.Nullable`1[System.Drawing.Color],System.Nullable`1[System.Drawing.Color])",
    SelectedTypeName="Objects.Other.RenderMaterial",
    UseSchemaTag=False,
    UserSetSchemaTag=False,
    seed="22022f06f2295f8bae6a")
to_speckle = ToSpeckle(Data=mesh_brep, selectedKitName="Objects")
extend_speckle_object = ExtendSpeckleObject(SpeckleObject=to_speckle, RenderMaterial=create_schema_object, selectedKitName="Objects")
panel_4 = Panel(extend_speckle_object)
send = Send(
    Stream="https://speckle.xyz/streams/c9c12bb7c7",
    Data=extend_speckle_object,
    AutoSend=False,
    BaseId="fce87142c05bac054b2a48c7b87df5ec",
    CurrentComponentState="up_to_date",
    KitName="Objects",
    OutputWrappers="https://speckle.xyz\tc9c12bb7c7\t220be2d3d6",
    UseDefaultCache=True,
    selectedKitName="Objects")

rendermaterial = RenderMaterial(
    Opacity="0.5",
    Metalness=0,
    Roughness=1,
    Diffuse=ColourSwatch(SwatchColor=RGB(227, 0, 0)),
    SelectedConstructorName="Objects.Other.RenderMaterial.ctor(System.Double,System.Double,System.Double,System.Nullable`1[System.Drawing.Color],System.Nullable`1[System.Drawing.Color])",
    SelectedTypeName="Objects.Other.RenderMaterial",
    UseSchemaTag=False,
    UserSetSchemaTag=False,
    seed="751f623aa418e7b99513")
pt_2 = ConstructPoint(XCoordinate=0, YCoordinate=0, ZCoordinate=0)
cso = CreateSpeckleObject(A="1", B="abc", C=pt_2, RenderMaterial=rendermaterial, selectedKitName="Objects")

# ----
# Orient to XY
profile_srf_2 = Surface(profile_srf)
pt_3 = ConstructPoint(XCoordinate=0.5, YCoordinate=0.5, ZCoordinate=0)
geo_3 = Geometry(geo_2)
evalsrf_2 = EvaluateSurface(Surface=profile_srf_2, Point=pt_3)  # -> Point, Normal, UDirection, VDirection, Frame
area = Area(Geometry=profile_srf_2)  # -> Area, Centroid
pl = PlaneNormal(Origin=area.Centroid, ZAxis=evalsrf_2.Normal)

pflip = FlipPlane(Plane=pl, ReverseX=False, ReverseY=False, SwapAxes=True)

orient = Orient(Geometry=graft(geo_3), Source=pflip, Target=PlaneXY(0, 0, 0))  # -> Geometry, Transform
rotate = Rotate(Geometry=orient.Geometry, Angle=1.570796327, Plane=PlaneXY(0, 0, 0))  # -> Geometry, Transform
geo_4 = Geometry(flatten(rotate.Geometry))

# ----
# Distribute by length
line_3 = Line(line_2)
geo_5 = Geometry(geo_4)
len_2 = Length(Curve=line_3)
lng = ListLength(List=geo_5)
sort_2 = SortList(Keys=len_2, ValuesA=geo_5)  # -> Keys, ValuesA
series = Series(Start=0, Step=1, Count=lng)
X = UnitX(Factor=series)
move = Move(Geometry=sort_2.ValuesA, Motion=X)  # -> Geometry, Transform

# ----
# Refresh the Material Bank
geo_6 = Geometry(move.Geometry)
panel_5 = Panel("https://speckle.xyz/streams/c9c12bb7c7")
null = NullItem(Item=geo_6)  # -> NullFlags, InvalidFlags, Description
dispatch = Dispatch(List=geo_6, DispatchPattern=null.NullFlags)  # -> ListA, ListB
send_2 = Send(
    Stream=panel_5,
    Message="Updated Material Bank",
    Data=dispatch.ListB,
    AutoSend=False,
    BaseId="6d232110cbb7b0392690ce81ecd80ae3",
    CurrentComponentState="expired",
    KitName="Objects",
    OutputWrappers="https://speckle.xyz\tc9c12bb7c7\t3b5a4cc7b7",
    UseDefaultCache=True,
    selectedKitName="Objects")
ss = SynchronousSender(
    Data=dispatch.ListB,
    Stream=panel_5,
    Message="Updated Material Bank",
    KitName="Objects",
    OutputWrappers="https://speckle.xyz\tc9c12bb7c7\td5c63f9783",
    UseDefaultCache=True)  # disabled
