# Grasshopper definition Send_models.gh (Grasshopper 1.0.7)
# plug-ins: BH.UI.Grasshopper, Speckle 2

geometry = Geometry([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])

# ---- group: Input
library = Library(LibraryName="EU_SteelSections", Component="{ .Library")

# ----
mesh_brep = MeshBrep(
    Brep=geometry,
    Settings={GridMaxCount=0, GridMinCount=16, JaggedSeams=False, MaxEdgeLength=0, MinEdgeLength=0.0001, MinTolerance=0, Refine=True, RefineAngle=0, RelativeTolerance=0.65, SimplePlanes=True, Tolerance=0})
create_schema_object = RenderMaterial(
    Opacity=1,
    Metalness=0,
    Roughness=1,
    Diffuse=[ColourSwatch(SwatchColor=RGB(235, 173, 49)), ColourSwatch(SwatchColor=RGB(52, 168, 66))],
    SelectedConstructorName="Objects.Other.RenderMaterial.ctor(System.Double,System.Double,System.Double,System.Nullable`1[System.Drawing.Color],System.Nullable`1[System.Drawing.Color])",
    SelectedTypeName="Objects.Other.RenderMaterial",
    UseSchemaTag=False,
    UserSetSchemaTag=False,
    seed="22022f06f2295f8bae6a")
to_speckle = ToSpeckle(Data=mesh_brep, selectedKitName="Objects")
extend_speckle_object = ExtendSpeckleObject(SpeckleObject=to_speckle, RenderMaterial=create_schema_object, selectedKitName="Objects")

# ---- group: Filter height
data = Data(library)
getproperty = GetProperty(Obj=data, PropName="SectionProfile", Component="{ .GetProperty")
getproperty_2 = GetProperty(Obj=getproperty, PropName="Height", Component="{ .GetProperty")
larger = LargerThan(FirstNumber=getproperty_2, SecondNumber="0.3")  # -> LargerThan, OrEqualTo
smaller = SmallerThan(FirstNumber=getproperty_2, SecondNumber="0.8")  # -> SmallerThan, OrEqualTo
and = GateAnd(A=larger.LargerThan, B=smaller.SmallerThan)
cull = CullPattern(List=data, CullPattern=and)

# ----
panel = Panel(extend_speckle_object)
send = Send(
    Stream="https://speckle.xyz/streams/c9c12bb7c7",
    Data=extend_speckle_object,
    AutoSend=False,
    BaseId="fce87142c05bac054b2a48c7b87df5ec",
    CurrentComponentState="up_to_date",
    KitName="Objects",
    OutputWrappers="https://speckle.xyz\tc9c12bb7c7\t220be2d3d6",
    UseDefaultCache=True,
    selectedKitName="Objects")

# ---- group: Pick N random profiles from the set
no_elements = Integer("2")
set_of_profiles = Data(cull)
lng = ListLength(List=set_of_profiles)
subtraction = Subtraction(A=lng, B="1")
dom = ConstructDomain(DomainStart="0", DomainEnd=subtraction)
random = Random(Range=dom, Number=no_elements, Seed=Slider(4, range=0..20))
round = Round(Number=random)  # -> Nearest, Floor, Ceiling
item = ListItem(List=set_of_profiles, Index=round.Nearest, Wrap=True)

# ---- group: Get relevant info about profiles
profiles = Data(item)
getproperty_3 = GetProperty(Obj=profiles, PropName="Iy", Component="{ .GetProperty")
getproperty_4 = GetProperty(Obj=profiles, PropName="Name", Component="{ .GetProperty")
getproperty_5 = GetProperty(Obj=profiles, PropName="SectionProfile", Component="{ .GetProperty")
panel_2 = Panel(getproperty_3)
panel_3 = Panel(getproperty_4)
getproperty_6 = GetProperty(Obj=getproperty_5, PropName="Edges", Component="{ .GetProperty")  # -> simplify(Value)

# ----
num = Number("2")
series = Series(Start=1, Step=1, Count=num)
boundary = BoundarySurfaces(Edges=getproperty_6)
X = UnitX(Factor=series)
series_2 = Series(Start=2, Step=0.3, Count=num)
move = Move(Geometry=boundary, Motion=graft(X))  # -> Geometry, Transform
Z = UnitZ(Factor=series_2)  # -> graft(UnitVector)
extr = Extrude(Base=move.Geometry, Direction=Z)  # -> flatten(Extrusion)
random_2 = Random(Range=Domain(0, 1), Number=num, Seed=Slider(16, range=0..20))
random_3 = Random(Range=Domain(0, 1), Number=num, Seed=Slider(11, range=0..20))
random_4 = Random(Range=Domain(0, 1), Number=num, Seed=Slider(6, range=0..20))
vec = VectorXYZ(XComponent=random_4, YComponent=random_3, ZComponent=random_2)  # -> Vector, Length
pl = PlaneNormal(Origin=Point(0, 0, 0), ZAxis=vec.Vector)
vec_2 = Vector(Vector(-17.15112865, 5.29479815, 0))
move_2 = Move(Geometry=pl, Motion=vec_2)  # -> Geometry, Transform
orient = Orient(Geometry=extr, Source=PlaneXY(0, 0, 0), Target=move_2.Geometry)  # -> Geometry, Transform
send_2 = Send(
    Stream="https://speckle.xyz/streams/c4c6aed0b8",
    Message="Model 11",
    Data=orient.Geometry,
    AutoSend=False,
    BaseId="678f71a04115adb3bc6966500089bc8e",
    CurrentComponentState="up_to_date",
    KitName="Objects",
    OutputWrappers="https://speckle.xyz\tc4c6aed0b8\t0282af34c3",
    UseDefaultCache=True,
    selectedKitName="Objects")
